# Grasshopper definition ScrewingLightbulb_HARDWARE.gh (Grasshopper 1.0.7)
# plug-ins: Robots

# ----
# rotation speed
panel = Panel("pi*20")
speed = CreateSpeed(Translation="5", Rotation=panel, ExternalTranslation=5000, ExternalRotation=18.84955592)

# ----
# TOOL
panel_2 = Panel("-0.62, -0.52, 66.82")
brep = Brep([<brep referenced from the Rhino model> x15])
pt = Point(panel_2)
mesh = MeshBrep(
    Brep=brep,
    Settings={GridMaxCount=0, GridMinCount=16, JaggedSeams=False, MaxEdgeLength=0, MinEdgeLength=0.0001, MinTolerance=0, Refine=True, RefineAngle=0, RelativeTolerance=0.65, SimplePlanes=True, Tolerance=0})
xy = XYPlane(Origin=pt)
mesh_2 = Mesh(<mesh referenced from the Rhino model>)
tool = CreateTool(Name="SquishyDeflated", TCP=xy, Weight=0, Mesh=mesh_2)  # -> Tool, TCP

# ----
# ROBOT DIGITAL OUTPUT
panel_3 = Panel("0")

# ----
# SPEED
panel_4 = Panel("30")

list = ValueList({"AA-KR60", "AA-KR30", "AA-KR60_KR30", "AARCH IRB120", "AARCH IRB6620", "AAU-Utzon-UR10", "Automata", "Bartlett-IRB120", "Bartlett-IRB1600", "Bartlett-KR6"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}, selected="iaac-IRB140")
load_robot = LoadRobotSystem(Name=list, Base=PlaneXY(0, 0, 0))

# ---- group: Robot Table display
abb_table_iaac = Geometry([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, Point(0, 0, 0)])
preview = CustomPreview(Geometry=abb_table_iaac, Shader=ColourSwatch(SwatchColor=RGB(222, 222, 222)))

# ----
# tool path start
number_slider = Slider(-180, range=-180..180)
merge = Merge(
    Data1=Slider(-6, range=-180..180),
    Data2=Slider(0, range=-180..180),
    Data3=Slider(0, range=-180..180),
    Data4=Slider(0, range=-180..180),
    Data5=Slider(0, range=-180..180),
    Data6=number_slider)
degtorad = DegreesToRadians(Degrees=merge, RobotSystem=load_robot, MechanicalGroup=0)
target = CreateTarget(Joints=degtorad, Tool=tool.Tool, Speed=graft(panel_4), IsCartesian=False)

# ----
# tool path end
number_slider_2 = Slider(90, range=-360..360)
merge_2 = Merge(
    Data1=Slider(-6, range=-180..180),
    Data2=Slider(0, range=-180..180),
    Data3=Slider(0, range=-180..180),
    Data4=Slider(0, range=-180..180),
    Data5=Slider(0, range=-180..180),
    Data6=number_slider_2)
degtorad_2 = DegreesToRadians(Degrees=merge_2, RobotSystem=load_robot, MechanicalGroup=0)
target_2 = CreateTarget(Joints=degtorad_2, Tool=tool.Tool, Speed=graft(panel_4), IsCartesian=False)

Z = UnitZ(Factor="5")

# ----
# screwing in the lightbulb
pt_2 = Point(<point referenced from the Rhino model>)
yz = YZPlane(Origin=pt_2)
setdo = SetDO(DO=panel_3, Value="False")
wait = Wait(Time="10")
setdo_2 = SetDO(DO=panel_3, Value="True")
wait_2 = Wait(Time="10")
setdo_3 = SetDO(DO=panel_3, Value="False")
wait_3 = Wait(Time="10")
rotate = Rotate(Geometry=yz, Angle="45", Plane=yz)  # -> Geometry, Transform
rotate_2 = Rotate(Geometry=rotate.Geometry, Angle="90", Plane=yz)  # -> Geometry, Transform
list_2 = ValueList({"Joint", "Linear"}, selected="Joint")
merge_3 = Merge(Data1=wait, Data2=setdo, Data3=wait)
rotate_3 = Rotate(Geometry=rotate.Geometry, Angle="90", Plane=yz)  # -> Geometry, Transform
merge_4 = Merge(Data1=wait_2, Data2=setdo_2, Data3=wait_2)
merge_5 = Merge(Data1=wait_3, Data2=setdo_3, Data3=wait_3)
wait_4 = Wait(Time="10")
list_3 = ValueList({"Joint", "Linear"}, selected="Joint")
list_4 = ValueList({"Joint", "Linear"}, selected="Joint")
list_5 = ValueList({"Joint", "Linear"}, selected="Joint")
list_6 = ValueList({"Joint", "Linear"}, selected="Joint")
groupcmd = GroupCommand(Commands=merge_3)
groupcmd_2 = GroupCommand(Commands=merge_4)
groupcmd_3 = GroupCommand(Commands=merge_5)
target_3 = CreateTarget(Plane=graft(yz), Motion=graft(list_2), Tool=tool.Tool, Speed=graft(speed), Command=wait_4, IsCartesian=True)
target_4 = CreateTarget(
    Plane=graft(rotate_2.Geometry),
    Motion=graft(list_4),
    Tool=tool.Tool,
    Speed=graft(speed),
    Command=groupcmd,
    IsCartesian=True)
target_5 = CreateTarget(Plane=graft(rotate.Geometry), Motion=graft(list_5), Tool=tool.Tool, Speed=graft(speed), IsCartesian=True)
target_6 = CreateTarget(Plane=graft(yz), Motion=graft(list_3), Tool=tool.Tool, Speed=graft(speed), Command=groupcmd_2, IsCartesian=True)
target_7 = CreateTarget(
    Plane=graft(rotate_3.Geometry),
    Motion=graft(list_6),
    Tool=tool.Tool,
    Speed=graft(speed),
    Command=groupcmd_3,
    IsCartesian=True)

X = UnitX(Factor="-100")
move = Move(Geometry=yz, Motion=X)  # -> Geometry, Transform
list_7 = ValueList({"Joint", "Linear"}, selected="Joint")
target_8 = CreateTarget(Plane=graft(move.Geometry), Motion=graft(list_7), Tool=tool.Tool, Speed=graft(panel_4), IsCartesian=True)

# ----
# REPEAT THE ROTATION OF THE LIGHTBULB
merge_6 = Merge(Data2=target_5, Data3=target_4, Data6=target_6, Data7=target_7)

merge_7 = Merge(Data3=target_6, Data4=target_7)

# ----
# MEDIUM LIGHTBULB
pt_3 = Point(<point referenced from the Rhino model>)
xy_2 = XYPlane(Origin=pt_3)
setdo_4 = SetDO(DO=panel_3, Value="True")
wait_5 = Wait(Time="8")
merge_8 = Merge(Data1=wait_5, Data2=setdo_4, Data3=wait_5)
list_8 = ValueList({"Joint", "Linear"}, selected="Linear")
groupcmd_4 = GroupCommand(Commands=merge_8)

Z_2 = UnitZ(Factor="100")
move_2 = Move(Geometry=xy_2, Motion=Z_2)  # -> Geometry, Transform
list_9 = ValueList({"Joint", "Linear"}, selected="Joint")
# toolpath data
pflip = FlipPlane(Plane=move_2.Geometry, ReverseX=False, ReverseY=False, SwapAxes=True)
target_9 = CreateTarget(Plane=pflip, Motion=list_9, Tool=tool.Tool, Speed=panel_4, IsCartesian=True)  # -> graft(Target)

move_3 = Move(Geometry=xy_2, Motion=Z)  # -> Geometry, Transform

pflip_2 = FlipPlane(Plane=move_3.Geometry, ReverseX=False, ReverseY=False, SwapAxes=True)
target_10 = CreateTarget(Plane=graft(pflip_2), Motion=graft(list_8), Tool=tool.Tool, Speed=graft(panel_4), Command=groupcmd_4, IsCartesian=True)

list_10 = ValueList({"Joint", "Linear"}, selected="Linear")
target_11 = CreateTarget(Plane=pflip, Motion=list_10, Tool=tool.Tool, Speed=panel_4, IsCartesian=True)  # -> graft(Target)

merge_9 = Merge(
    Data1=target_9,
    Data2=target_10,
    Data3=target_11,
    Data5=target_8,
    Data6=target_3,
    Data7=merge_6,
    Data8=merge_7,
    Data9=merge_7,
    Data10=merge_7,
    Data11=merge_7,
    Data12=target_4)
entwine = Entwine(Branch00=target, Branch01=merge_9, Branch02=target_2, FlattenInputs=True)
program = CreateProgram(Name="SquishyOutput", RobotSystem=load_robot, Targets1=flatten(entwine), StepSize=1)  # -> Program, Code, Duration, Warnings, Errors
panel_5 = Panel(program.Warnings)
panel_6 = Panel(program.Errors)
sim = ProgramSimulation(Program=program.Program, Time=Slider(0.623, range=0..1), Normalized=True)  # -> SystemMeshes, JointRotations, Plane, Index, Time, Program, Errors
panel_7 = Panel(sim.JointRotations)

# ---- group: to export file
txt = Text(flatten(program.Code))
path = FilePath("C:\Users\atask\Desktop\hardware toolpath\")
file_name = Panel("HARDWARE_Lightbulb_03")
python = GhPythonScript(program=txt, path=path, name=file_name, write=Button())  # -> out, a; inputs program: list
# ---------- python: Python ----------
__author__ = "kunal"
__version__ = "2018.10.16"

import rhinoscriptsyntax as rs

if write:
    with open(path + name + '.prg', 'w') as file:
        for line in program:
            file.write(line)
            file.write('\n')
# ---------- end python ----------
